# Grasshopper definition ResultVisualization.gh (Grasshopper 1.0.7)
# plug-ins: Kangaroo Components

panel = Panel("G:\01_Projekte\270_PhD_SpatialTimberStructures\04_Tools\Intel RealSense D415\Mount Calibration\data\")
concat = Concatenate(FragmentA=panel, FragmentB="1545060831.obj")
concat_2 = Concatenate(FragmentA=panel, FragmentB="1545060997.obj")
file = ReadFile(File="C:\Users\leungp\Documents\GitHub\gkricp\results.txt", PerLineParse=True)
concat_3 = Concatenate(FragmentA=panel, FragmentB="1545061136.obj")
concat_4 = Concatenate(FragmentA=panel, FragmentB="1545061367.obj")
tmatch = MatchText(Text=file, Pattern=" TRANSFORMATION:*", Case=True)
python = GhPythonScript(obj_path=concat, decimate=20)  # -> out, resultPts; inputs decimate: Int32
# ---------- python: Python ----------
__author__ = "leungp"
__version__ = "2018.12.17"

#Read the points back

import Rhino

#resultPts = Rhino.Geometry.PointCloud()
resultPts = []
count = 0
with open(obj_path) as resultcsv:
    for line in resultcsv:
        if line.startswith( 'v ' ):
            if count % decimate == 0 :
                coordinates = line.split()
                #resultPts.Add(Rhino.Geometry.Point3d(float(coordinates[1]),float(coordinates[2]),float(coordinates[3])))
                resultPts.append(Rhino.Geometry.Point3d(float(coordinates[1]),float(coordinates[2]),float(coordinates[3])))
            count +=1
    print (count)
# ---------- end python ----------
python_2 = GhPythonScript(obj_path=concat_2, decimate=20)  # -> out, resultPts; inputs decimate: Int32; same code as python
python_3 = GhPythonScript(obj_path=concat_3, decimate=20)  # -> out, resultPts; inputs decimate: Int32; same code as python
python_4 = GhPythonScript(obj_path=concat_4, decimate=20)  # -> out, resultPts; inputs decimate: Int32; same code as python
cull = CullPattern(List=file, CullPattern=tmatch)
rep = ReplaceText(Text=cull, Find=" TRANSFORMATION:[", RecursiveReplace=False)
rep_2 = ReplaceText(Text=rep, Find="]", RecursiveReplace=False)
split = TextSplit(Text=rep_2, Separators=",")
transform = Transform(flatten([{TransformCount=1, Name="Generic", m00=0.99959762, m01=-0.00666174, m02=0.02757191, m03=0.00606086, m10=3.51e-05, m11=0.97232004, m12=0.23365301, m13=-0.07117215, m20=-0.02836526, m21=-0.23355803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}, {TransformCount=1, Name="Generic", m00=0.99989642, m01=-0.00746595, m02=0.0123046, m03=0.01231644, m10=0.00449589, m11=0.97417565, m12=0.22574673, m13=-0.06838707, m20=-0.01367226, m21=-0.22566803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}, {TransformCount=1, Name="Generic", m00=0.99978588, m01=-0.00821535, m02=0.01899219, m03=0.01161463, m10=0.00364464, m11=0.97337565, m12=0.22918673, m13=-0.06911842, m20=-0.02036938, m21=-0.22906843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}, {TransformCount=1, Name="Generic", m00=0.99989397, m01=-0.0087572, m02=0.01163409, m03=0.01528725, m10=0.00590296, m11=0.97412912, m12=0.22591507, m13=-0.06781892, m20=-0.01331149, m21=-0.22582244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}, {TransformCount=1, Name="Generic", m00=0.99986821, m01=-0.00902811, m02=0.01349258, m03=0.01598862, m10=0.0057306, m11=0.97388365, m12=0.22697533, m13=-0.06788519, m20=-0.01518936, m21=-0.2268681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}, {TransformCount=1, Name="Generic", m00=0.99991175, m01=-0.00911529, m02=0.00966476, m03=0.01839908, m10=0.00670186, m11=0.97422761, m12=0.22546764, m13=-0.06718689, m20=-0.01147088, m21=-0.22538297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}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]))
transform_2 = Transform(flatten([{TransformCount=1, Name="Generic", m00=0.99898215, m01=-0.04428797, m02=0.00855848, m03=0.00666041, m10=0.04100826, m11=0.97073247, m12=0.23663641, m13=-0.0821548, m20=-0.01878814, m21=-0.23604458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}, {TransformCount=1, Name="Generic", m00=0.99889223, m01=-0.04663901, m02=-0.00625425, m03=0.01217959, m10=0.04683438, m11=0.97245903, m12=0.22831991, m13=-0.0794227, m20=-0.00456662, m21=-0.2283599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}, {TransformCount=1, Name="Generic", m00=0.99855031, m01=-0.05382414, m02=-0.00048987, m03=0.01122231, m10=0.05246655, m11=0.97125084, m12=0.23220479, m13=-0.08052447, m20=-0.01202244, m21=-0.23189386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}, {TransformCount=1, Name="Generic", m00=0.99828215, m01=-0.05799476, m02=-0.00832841, m03=0.01445124, m10=0.05836242, m11=0.97180284, m12=0.22845802, m13=-0.07925037, m20=-0.0051558, m21=-0.22855163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}, {TransformCount=1, Name="Generic", m00=0.9979052, m01=-0.06436709, m02=-0.00648702, m03=0.01458079, m10=0.06413297, m11=0.97111121, m12=0.22984774, m13=-0.0796047, m20=-0.00849501, m21=-0.22978229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}, {TransformCount=1, Name="Generic", m00=0.99753617, m01=-0.06925399, m02=-0.0112012, m03=0.01671328, m10=0.0699823, m11=0.97116507, m12=0.22790541, m13=-0.0789294, m20=-0.00490515, m21=-0.22812778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}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]))
transform_3 = Transform(flatten([{TransformCount=1, Name="Generic", m00=0.99906936, m01=0.02006358, m02=-0.03818202, m03=0.00148603, m10=-0.01592126, m11=0.99425386, m12=0.10585738, m13=-0.0398706, m20=0.0400865, m21=-0.10515096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}, {TransformCount=1, Name="Generic", m00=0.9998309, m01=0.0114262, m02=-0.01440877, m03=-0.00761136, m10=-0.00978216, m11=0.99394795, m12=0.1094156, m13=-0.04096702, m20=0.01557177, m21=-0.10925615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}, {TransformCount=1, Name="Generic", m00=0.9996705, m01=0.01237568, m02=-0.02248856, m03=-0.00647077, m10=-0.00985378, m11=0.99399494, m12=0.10898148, m13=-0.04074697, m20=0.02370223, m21=-0.10872398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}, {TransformCount=1, Name="Generic", m00=0.99988005, m01=0.00802945, m02=-0.01324423, m03=-0.01089074, m10=-0.00652604, m11=0.9939225, m12=0.10988847, m13=-0.04100418, m20=0.01404608, m21=-0.10978886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}, {TransformCount=1, Name="Generic", m00=0.99987625, m01=0.0066427, m02=-0.01426061, m03=-0.01198194, m10=-0.00502813, m11=0.99387354, m12=0.11040883, m13=-0.04111509, m20=0.01490665, m21=-0.11032347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}, {TransformCount=1, Name="Generic", m00=0.99994305, m01=0.0036651, m02=-0.01002308, m03=-0.01470579, m10=-0.0025332, m11=0.99385115, m12=0.11069544, m13=-0.04116182, m20=0.01036716, m21=-0.11066374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}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]))
timer = Timer(TimerInterval=200, Target=counter)
construct_transformation = ConstructTransformation(transformation_numbers=split)  # -> transform; inputs transformation_numbers: list
# ---------- construct_transformation: Python ----------
from ghpythonlib.componentbase import executingcomponent as component
import Grasshopper, GhPython
import System
import Rhino
import rhinoscriptsyntax as rs

class MyComponent(component):
    
    def RunScript(self, transformation_numbers):
        """Provides a scripting component.
            Inputs:
                x: The x script variable
                y: The y script variable
            Output:
                a: The a output variable"""
        
        __author__ = "leungp"
        __version__ = "2018.12.18"
        
        
        import Rhino
        
        transform = Rhino.Geometry.Transform(1.0)
        if transformation_numbers.Count == 16:
            for i in xrange(4):
                for j in xrange(4):
                    print i , "," , j
                    transform[i,j] = transformation_numbers[i * 4 + j]
        else:
            transform = []
        # return outputs if you have them; here I try it for you:
        return transform
# ---------- end construct_transformation ----------
counter = Counter(Reset=Button())
number_slider = Slider(39, range=0..100)
item = ListItem(List=transform, Index=number_slider, Wrap=True)
filter_points = FilterPoints_2(pt=python_3.resultPts, x=Slider(20, range=0..100))
item_2 = ListItem(List=transform_2, Index=Slider(81, range=0..99), Wrap=True)
item_3 = ListItem(List=transform_3, Index=Slider(44, range=0..99), Wrap=True)
filter_points_2 = FilterPoints(pt=python_2.resultPts, x=Slider(20, range=0..100))
transform_4 = Transform(Geometry=python_2.resultPts, Transform=item)
panel_2 = Panel(number_slider)
transform_5 = Transform(Geometry=python_3.resultPts, Transform=item_2)
transform_6 = Transform(Geometry=python_4.resultPts, Transform=item_3)
preview = CustomPreview(Geometry=transform_4, Material=ColourSwatch(SwatchColor=RGB(77, 255, 0)))
preview_2 = CustomPreview(Geometry=transform_5, Material=ColourSwatch(SwatchColor=RGB(77, 255, 0)))
preview_3 = CustomPreview(Geometry=transform_6, Material=ColourSwatch(SwatchColor=RGB(77, 255, 0)))

item_4 = ListItem(List=transform_3, Index=-1, Wrap=True)
item_5 = ListItem(List=transform_2, Index=-1, Wrap=True)
item_6 = ListItem(List=transform, Index=-1, Wrap=True)
transform_7 = Transform(Geometry=python_4.resultPts, Transform=item_4)
transform_8 = Transform(Geometry=transform_7, Transform=item_5)
transform_9 = Transform(Geometry=python_3.resultPts, Transform=item_5)
transform_10 = Transform(Geometry=python_2.resultPts, Transform=item_6)
transform_11 = Transform(Geometry=transform_9, Transform=item_6)
transform_12 = Transform(Geometry=transform_8, Transform=item_6)
pt = Point(python.resultPts)

# ==== cluster FilterPoints
pt = ClusterInput()
x = ClusterInput()
pt_2 = Point(pt)
Z = UnitZ(Factor=1)
unit = UnitVector(Vector=pt_2)
dprod = DotProduct(VectorA=unit, VectorB=Z, Unitize=False)
cos = Cosine(Value=degrees(x))
larger = LargerThan(FirstNumber=dprod, SecondNumber=cos)  # -> LargerThan, OrEqualTo
cull = CullPattern(List=pt_2, CullPattern=larger.LargerThan)
L = ClusterOutput(cull)

# ==== cluster FilterPoints_2
pt = ClusterInput()
pt_2 = Point(pt)
Z = UnitZ(Factor=1)
unit = UnitVector(Vector=pt_2)
x = ClusterInput()
dprod = DotProduct(VectorA=unit, VectorB=Z, Unitize=False)
cos = Cosine(Value=degrees(x))
larger = LargerThan(FirstNumber=dprod, SecondNumber=cos)  # -> LargerThan, OrEqualTo
cull = CullPattern(List=pt_2, CullPattern=larger.LargerThan)
L = ClusterOutput(cull)
